# Requirement set CommsStandardRequirements (R2024b)

## 1 [#1] Uplink Frequencies

### 1.1 [#2] S-band Frequencies
The low rate antenna component "status" variable shall be set to "on" when a s-band signal between 2 and 4 gigahertz (GHz) is received by the communication subsystem.